# Grasshopper definition test2.gh (Grasshopper 1.0.7)
# plug-ins: BITS

panel = Panel("""{
    "@context": {
      "@vocab": "http://bsi.org/ifc/4x3/",
      "@base": "http://myfile.org/ids/",
      "ref": "@id",
      "data": "@graph",
      "type": "@type",
      "globalId": "@id"
    },
    "@type": "IfcProject",
    "@explicit": true,
    "isDecomposedBy": {
      "@explicit": true,
      "relatedObjects": {
        "@explicit": true,
        "containsElements": {
          "@explicit": true,
          "relatedElements": {
            "@explicit": true,
            "isNestedBy": {
              "@explicit": true,
              "relatedObjects": {
                "@explicit": true
              }
            }
          }
        }
      }
    }
  }""")
file_path = FilePath("C:\Users\Nirvik Saha\Documents\PostDoc\jsonLD\wall_door_data\data_framing\wall_door.json")
file_path_2 = FilePath("C:\Users\Nirvik Saha\Documents\PostDoc\jsonLD\wall_door_data\data_framing\wall_door.json")
jsonld_framing_text = JsonLD_Framing_Text(InputIfcJsonLD=file_path, InputFrameDefinition=panel)  # -> OutputFramedData, Debug
json_ld_expanded = JsonLDExpanded(PathToIfcJsonFile=file_path_2)
jsonformattingmain = JsonFormattingMain(InputJson="{a:12, b:23, c:[1,2,3]}")
panel_2 = Panel(jsonld_framing_text.Debug)
panel_3 = Panel(jsonformattingmain)
panel_4 = Panel(jsonld_framing_text.OutputFramedData)
panel_5 = Panel(json_ld_expanded)
