# Grasshopper definition webApi.gh (Grasshopper 1.0.7)
# plug-ins: BITS

file_path = FilePath("C:\Users\Nirvik Saha\source\repos\BITS\bin\data\wall_door.ifc")
ifc_json_from_step = IfcJsonFromStep(InputIFCFile=file_path, InputURL="http://127.0.0.1:5000/post/data", StartProcess=Toggle(False))  # disabled
sample_ifc_json = SampleIfcJson(InputURL="http://127.0.0.1:5000/get/data", StartProcess=Toggle(False))  # disabled
panel = Panel(sample_ifc_json)
panel_2 = Panel(ifc_json_from_step)
